# Grasshopper definition Worley_Noise_01.gh (Grasshopper 1.0.7)

number_slider = Slider(2, range=0..10)
number_slider_2 = Slider(10, range=0..100)
number_slider_3 = Slider(10, range=0..100)
number_slider_4 = Slider(10, range=0..100)
construct_point = ConstructPoint(XCoordinate=0, YCoordinate=0, ZCoordinate=0)
rectangle = Rectangle(Plane=PlaneXY(0, 0, 0), XSize=number_slider, YSize=number_slider, Radius=0)  # -> Rectangle, Length
series = Series(Start=0, Step=1, Count=number_slider_4)
c_script = CSharpScript(x=number_slider_2, y=number_slider_3, z=number_slider_4, num=Slider(5, range=0..10))  # -> out, A; inputs x: Int32, y: Int32, z: Int32, num: Int32
# ---------- c_script: C# ----------
    List<Point3d> pts = new List<Point3d>();
    Random rand = new Random();

    for(int i = 0; i < num; i++){
      double x1 = rand.Next(x );
      double y1 = rand.Next(y );
      double z1 = rand.Next(z );
      pts.Add(new Point3d(x1, y1, z1));
    }

    A = pts;
# ---------- end c_script ----------
unit_z = UnitZ(Factor=series)  # -> graft(UnitVector)
rectangular_array = RectangularArray(Geometry=construct_point, Cell=rectangle.Rectangle, XCount=number_slider_2, YCount=number_slider_3)  # -> Geometry, Transform
panel = Panel(c_script.A)
sphere = Sphere(Base=c_script.A, Radius=1)
move = Move(Geometry=rectangular_array.Geometry, Motion=unit_z)  # -> simplify(Geometry), Transform
param_viewer = ParamViewer(move.Geometry)
