# Grasshopper definition Room_Data_01.gh (Grasshopper 1.0.7)
# plug-ins: Konstru

levels = Panel("""0
10""")
max_pt = Panel("""-0.161300525575361
-1.63108976609036
5""")
min_pt = Panel("""-9.49463385890869
-15.9644230994237
0""")
construct_point = ConstructPoint(XCoordinate=0, YCoordinate=0, ZCoordinate=levels)
list_item = ListItem(List=levels, Index=0, Wrap=True)  # -> Item, Item1
rectangle = Rectangle(Plane=PlaneXY(0, 0, 0), XSize="10", YSize="15", Radius=0)  # -> Rectangle, Length
numbers_to_points = NumbersToPoints(Numbers=max_pt, Mask=4)
numbers_to_points_2 = NumbersToPoints(Numbers=min_pt, Mask=4)
explode = Explode(Curve=rectangle.Rectangle, Recursive=True)  # -> Segments, Vertices
xy_plane = XYPlane(Origin=construct_point)
box_2pt = Box2Pt(PointA=numbers_to_points, PointB=numbers_to_points_2, Plane=PlaneXY(0, 0, 0))
wall = Wall(Curve=explode.Segments, Height=list_item.Item1, Width=Slider(0.75, range=0..1))  # -> flatten(Element), flatten(Geometry)
deconstruct_box = DeconstructBox(Box=box_2pt)  # -> Plane, X, Y, Z
box_corners = BoxCorners(Box=box_2pt)  # -> CornerA, CornerB, CornerC, CornerD, CornerE, CornerF, CornerG, CornerH
panel = Panel(wall.Geometry)
panel_2 = Panel(deconstruct_box.X)
panel_3 = Panel(deconstruct_box.Y)
panel_4 = Panel(deconstruct_box.Z)
xz_plane = XZPlane(Origin=box_corners.CornerF)
aligned_dimension = AlignedDimension(Plane=xz_plane, PointA=box_corners.CornerB, PointB=box_corners.CornerF, Offset=1, Text="{0:0.00}", Size=1)
distance = Distance(PointA=box_corners.CornerA, PointB=box_corners.CornerB)
distance_2 = Distance(PointA=box_corners.CornerB, PointB=box_corners.CornerC)
distance_3 = Distance(PointA=box_corners.CornerB, PointB=box_corners.CornerF)
aligned_dimension_2 = AlignedDimension(Plane=PlaneXY(0, 0, 0), PointA=box_corners.CornerB, PointB=box_corners.CornerC, Offset=1, Text="{0:0.00}", Size=1)
panel_5 = Panel(distance)
panel_6 = Panel(distance_2)
panel_7 = Panel(distance_3)
aligned_dimension_3 = AlignedDimension(Plane=PlaneXY(0, 0, 0), PointA=box_corners.CornerA, PointB=box_corners.CornerB, Offset=1, Text="{0:0.00}", Size=1)
panel_8 = Panel("Unbound Height = 10")

location_point = Panel("""-5.08448454273062
-8.38817915252346
0""")
numbers_to_points_3 = NumbersToPoints(Numbers=location_point, Mask=4)

multiplication = Multiplication(A=panel_5, B=panel_6)
surface_area = Panel(multiplication)

multiplication_2 = Multiplication(A=panel_5, B="2")
multiplication_3 = Multiplication(A="2", B=panel_6)
addition = Addition(A=multiplication_2, B=multiplication_3)
perimiter = Panel(addition)
